vi "FrameSync.gvi"   [LabVIEW NXG 3.0.0]
inputs:
  "input signal": c128[]
  "barker code": enum{"5", "7", "11", "random"} = "random"
  "sync frame index (symbols)": i32 = 16
  "samples per symbol": f64 = 16
  "sync frame buffer (symbols)": i32 = 16
  "error in": error
  "Min correlation": f64
outputs:
  "output signal": c128[]
  "max index": i32
  "Training Subcodes": c128[][]
  "error out": error
  "Correlation": f64[]
uses:
  NI::Analysis::Operations::1D Cross Correlation (CDB).gvi
  NI::G Core::Error::Build Error Cluster.gvi
diagram:
  To Long Integer(number=$"samples per symbol") -> w1
  Multiply($"sync frame buffer (symbols)", w1) -> w2
  Reciprocal(x=$"samples per symbol") -> w3
  call "BarkerCode.gvi"(barker code=$"barker code") -> (code=w4, length of one subcode=w5, subcodes=w6)
  To Double Precision Complex(number=w4) -> w7
  # w6: subcode count
  call "Upsampler.gvi"(Signal in=w7, Samples per symbol=$"samples per symbol", error in=$"error in") -> (Upsampled signal=w8, error out=w9)
  Array Size(array=w8) -> (size(s)=w10)
  Multiply(w10, 1.136, w3) -> w11: f64
  Multiply($"sync frame index (symbols)", w1) -> w12
  # w13: index - buffer
  Subtract(x=w12, y=w2) -> w13
  # w5: length of one subcode
  Array Size(array=w4) -> (size(s)=w14)
  # w14: sync frame length
  Multiply(w1, w14) -> w15
  Multiply(w2, 2) -> w16
  # w17: length + 2*buffer
  Add(w16, w15) -> w17
  # Reduce the search area
  Array Subset(array=$"input signal", index0=w13, length0=w17) -> w18
  Array Size(array=w18) -> (size(s)=w19)
  Is Greater Than 0(x=w19) -> w20
  Decrement(x=w19) -> w21
  Add(w21, w10) -> w22
  Initialize Array(element=0, size=w22) -> w23
  # Perform cross correlation between the signal and each of the subcodes
  case (w20) {
    frame False, Default {
      w24 = w9
      w25 = f64[] []
      w26 = TRUE
    }
    frame True {
      # Moves the position of the subcode
      # so that the correlation indices overlap
      call "1D Cross Correlation (CDB).gvi"(x=w8, y=w18, error in=w9) -> (Rxy=w27, error out=w24)
      Array Subset(array=w27, index0=w10) -> w28
      Absolute Value(x=w28) -> w29
      Add(w23, w29) -> w25
      call "Subcodemask.gvi"(input=w8, subcode length=w5, samples per symbol=$"samples per symbol")
      w26 = FALSE
    }
  }
  Divide(x=w25, y=w11) -> w30
  Array Max And Min(array=w30) -> (max index(es)=w31, max value=w32)
  Increment(x=w31) -> w33
  Subtract(x=w33, y=w2) -> w34
  # Shift the signal with the sync index
  Array Subset(array=$"input signal", index0=w34) -> w35
  $"output signal" <- w35
  # Find index and value of max correlation
  $Correlation <- w30
  $"max index" <- w33
  Multiply($"samples per symbol", w5) -> w36
  # Creates array of the correlated
  # subcodes at the max correlation
  for (N = w6) (iteration -> i1) {
    Multiply(w36, i1) -> w38
    Add(w33, w38) -> w39
    Array Subset(array=w18, index0=w39, length0=w36) -> w40
    append w40 to w37
  }
  $"Training Subcodes" <- w37
  Is Less(x=w32, y=$"Min correlation") -> w41
  Logical Or(w41, w26) -> w42
  # Throws an error if the correlation is below a threshold
  case (w42) {
    frame False, Default {
      w43 = w24
    }
    frame True {
      call "Build Error Cluster.gvi"(error in=w24, code=1234567, description="Frame sync failed") -> (error out=w43)
    }
  }
  $"error out" <- w43
