vi "FreqSync.gvi"   [LabVIEW NXG 3.0.0]
inputs:
  "input": c128[]
  "Training codes": c128[][]
  "Samples per symbol": f64 = 1
  "error in": error
  "barker code": enum{"5", "7", "11", "random"} = "random"
  "Frame index": i32
outputs:
  "output": c128[]
  "error out": error
  "phase drift": f64
  "phase offset": f64
  "correction angles": f64[]
panel indicators:
  "Output_2": f64[]
uses:
  NI::Analysis::Conditioning::Unwrap Phase.gvi
  NI::Analysis::Statistics::Median.gvi
  NI::Analysis::Generation::Ramp Pattern by Samples.gvi
diagram:
  call "BarkerCode.gvi"(barker code=$"barker code") -> (code=w1, length of one subcode=w2)
  # Least square estimation of phase with the reference code
  for (N -> w3) {
    w4 = each element of $"Training codes"
    Array Subset(array=w1, index0=w2, length0=w3) -> w6
    To Double Precision Complex(number=w6) -> w7
    Complex Conjugate(x + iy=w7) -> w8
    Multiply(w8, w4) -> w9
    Add Array Elements(numeric array=w9) -> (sum=w10)
    # Calculates the phase offset
    Complex To Polar(r * e^(i*theta)=w10) -> (theta=w11)
    append w11 to w5
  }
  $Output_2 <- w5
  # compensate by multiplying with e^-j(n*phase/sub code length)
  Array Index(array=$"Training codes") -> (out0[0, _]=w12)
  Array Size(array=$"Training codes") -> (size(s)=w13)
  Array Index(array=w13) -> (out0[0]=w14)
  Decrement(x=w14) -> w15
  # Moose's algorithm
  for (N = w15) (iteration -> i1) {
    # Calculates the phase drift
    Increment(x=i1) -> w17
    Array Index(array=$"Training codes") -> (out0[w17, _]=w18)
    Array Size(array=w18) -> (size(s)=w19)
    Multiply(w19, w17) -> w20
    Complex Conjugate(x + iy=w12) -> w21
    Multiply(w21, w18) -> w22
    Add Array Elements(numeric array=w22) -> (sum=w23)
    Complex To Polar(r * e^(i*theta)=w23) -> (theta=w24)
    Divide(x=w24, y=w20) -> w25
    append w25 to w16
  }
  call "Unwrap Phase.gvi"(input phase=w16, error in=$"error in") -> (unwrapped phase=w26, error out=w27)
  call "Median.gvi"(x=w26, error in=w27) -> (median=w28, error out=w29)
  call "Unwrap Phase.gvi"(input phase=w5, error in=w29) -> (unwrapped phase=w30, error out=w31)
  call "Median.gvi"(x=w30, error in=w31) -> (median=w32, error out=w33)
  Multiply($"Samples per symbol", $"Frame index") -> w34
  Multiply(w28, w34) -> w35
  Subtract(x=w32, y=w35) -> w36
  Array Size(array=$input) -> (size(s)=w37)
  # n*phase
  # from 0 to N
  Add(w37, 0) -> w38
  Multiply(w28, w38) -> w39
  # create phase compensation array
  call "Ramp Pattern by Samples.gvi"(samples=w38, end=w39, error in=w33) -> (ramp pattern=w40, error out=w41)
  Add(w40, w36) -> w42
  Negate(x=w42) -> w43
  Polar To Complex(r=1, theta=w43) -> (r * e^(i*theta)=w44)
  Multiply($input, w44) -> w45
  $output <- w45
  $"phase offset" <- w36
  $"error out" <- w41
  Array Index(array=w13) -> (out0[1]=w46)
  Multiply(w46, w14)
  $"phase drift" <- w28
