vi "ReceiverBlock2.0.gvi"   [LabVIEW NXG 3.0.0]
panel controls:
  "IQ rate": f64 = 160000
  "carrier frequency": f64 = 2450000000
  "gain (dB)": f64 = 10
  "active antenna": string = "RX2"
  "Device names": string = "USRP_06"
  "RF Channel": string = "1"
  "Symbol rate (sym/s)": i32 = 10000
  "filter length": i32 = 8
  "message length (symbols)": i32 = 88
  "sync frame index (symbols)": i32 = 44
  "Power Threshold": f64 = 1e-07
  "Frame sync": bool = TRUE
  "Freq sync": bool = TRUE
  "barker code": enum{"5", "7", "11", "random"} = "random"
  "decoding": bool
  "Interleaver": bool
  "filter parameter": f64 = 0.5
  "number of samples per USRP fetch": i64 = 20000
  "Stop_RX_2": bool
  "milliseconds to wait": u32
  "Reset BER": bool
  "Receive sound": bool
  "window length": i32 = 20
  "Extra buffer backwards": i32 = 500
  "receiver on": bool = TRUE
  "y": i32 = 500
  "preamble?": bool = TRUE
  "preamble code": enum{"5", "7", "11", "random"} = "random"
  "Correlation threshold": f64 = 0.00055
panel indicators:
  "actual IQ rate": f64
  "actual carrier frequency": f64
  "actual gain (dB)": f64
  "error out": error
  "dequeueing iteration": i32
  "IQ diagram": c128[]
  "samples/symbol": f64
  "sync frame correlation": f64[]
  "enqueueing iteration": i32
  "size(s)": i32
  "number elements in queue": i32
  "current index": i32
  "one package": f64[]
  "BER graph": f64[]
  "Mean_BER": f64
  "current BER": f64
  "Input array size": i32
  "Output array size": i32
  "Correct Size": bool
  "string": string
  "Raw input": f64[]
  "max correlation": f64
uses:
  NI::USRP::niUSRP Open Rx Session.gvi
  NI::USRP::niUSRP Configure Signal.gvi
  NI::USRP::niUSRP Initiate.gvi
  NI::USRP::niUSRP Fetch Rx Data (CDB).gvi
  NI::Modulation::MT Pack Bits.gvi
  NI::USRP::niUSRP Abort.gvi
  NI::USRP::niUSRP Close Session.gvi
diagram:
  w1 = $"RF Channel"
  call "niUSRP Open Rx Session.gvi"(device names=$"Device names") -> (session handle out=w2, error out=w3)
  Property Node(instance in=w2, "niUSRP"=w1, error in=w3) -> (error out=w4, instance out=w5)
  call "niUSRP Configure Signal.gvi"(active antenna=$"active antenna", session handle=w5, error in=w4, IQ rate=$"IQ rate", carrier frequency=$"carrier frequency", gain=$"gain (dB)", channel list=w1) -> (session handle out=w6, error out=w7, coerced IQ rate=w8, coerced carrier frequency=w9, coerced gain=w10)
  call "niUSRP Initiate.gvi"(session handle=w6, error in=w7) -> (session handle out=w11, error out=w12)
  Obtain Notifier(element data type=bool TRUE, error in=w12, name="error") -> (error out=w13, notifier out=w14)
  Obtain Queue(element data type=c128[] [], error in=w13) -> (error out=w15, queue out=w16)
  w17 = $"number of samples per USRP fetch"
  s1 = w15  # shift register
  s2 = w16  # shift register
  while (iteration -> i1) {
    Get Notifier Status(notifier=w14) -> (latest notification=w18)
    # Producer loop
    case (w18) {
      frame True {
        w19 = w11
        w20 = s2
        w21 = s1
      }
      frame False {
        call "niUSRP Fetch Rx Data (CDB).gvi"(session handle=w11, error in=s1, number of samples=w17, channel list=w1) -> (session handle out=w19, error out=w22, data=w23)
        Enqueue Element(element=w23, error in=w22, queue=s2) -> (error out=w21, queue out=w20)
        call "NotifyError.gvi"(notifier ref=w14, error in=w21)
      }
    }
    $"enqueueing iteration" <- i1
    next s1 = w21
    next s2 = w20
    stop if w18
  }
  Obtain Queue(element data type=u8[] [], error in=w13) -> (error out=w24, queue out=w25)
  s3 = w15  # shift register
  s4 = w16  # shift register
  s5 = uninitialised  # shift register
  s6 = c128[] []  # shift register
  while (iteration -> i2) {
    Dequeue Element(error in=s3, queue=s4) -> (element=w26, queue out=w27)
    Get Queue Status(queue=w27) -> (# elements in queue=w28)
    $"number elements in queue" <- w28
    Insert Into Array(inArray=s6, new=w26) -> w29
    Array Size(array=w29) -> (size(s)=w30)
    # Consumer loop
    w31 = $"barker code"
    w32 = $"sync frame index (symbols)"
    w33 = $"message length (symbols)"
    w34 = $"Symbol rate (sym/s)"
    To Double Precision Float(number=w34) -> w35
    Divide(x=w8, y=w35) -> w36
    call "BarkerCode.gvi"() -> (length of one subcode=w37, subcodes=w38)
    Multiply(w37, w38) -> w39
    Add(w33, w39) -> w40
    To Long Integer(number=w36) -> w41
    Multiply(w40, w41) -> w42
    Multiply(w42, 1) -> w43
    w44 = $"Extra buffer backwards"
    s7 = w44  # shift register
    s8 = s5  # shift register
    while {
      case ($"preamble?") {
        frame False, Default {
          call "PacketDetector.gvi"(input=w29, Power Threshold=$"Power Threshold", window length=$"window length") -> (detected?=w45)
          w46 = w15
        }
        frame True {
          call "PacketDetectorPreamble.gvi"(input=w29, Samples per symbol=w36, index=s7, error in=w15, Correlation threshold=$"Correlation threshold", window length=$"window length", preamble code=$"preamble code") -> (detected?=w45, max correlation=w47, error out=w46)
          $"max correlation" <- w47
        }
      }
      Array Size(array=w29) -> (size(s)=w48)
      Subtract(x=s7, y=w44) -> w49
      Is Greater Or Equal To 0(x=w49) -> w50
      # Add buffer
      # w51: index - buffer
      case (w50) {
        frame False, Default {
          w51 = s7
        }
        frame True {
          w51 = w49
        }
      }
      # s7: current index
      Multiply(w44, 2) -> w52
      # w53: length + buffer
      # length to check
      Add(w52, w43) -> w53
      case (w45) {
        frame False, Default {
          # w44: Extra buffer backwards
          Add($"window length", s7) -> w55
          # w55: next index
          Subtract(x=w48, y=w55) -> w59
          Is Less Or Equal To 0(x=w59) -> w54
          # check if done
          case (w54) {
            frame False, Default {
              w57 = c128[] []
            }
            frame True {
              Subtract(x=w48, y=$y) -> w60
              Array Subset(array=w29, index0=w60) -> w57
            }
          }
          w56 = w46
          w58 = s8
        }
        frame True {
          Array Subset(array=w29, index0=w51, length0=w53) -> w61
          Add(s7, w53) -> w55
          Subtract(x=w48, y=w55) -> w62
          Is Less Or Equal To 0(x=w62) -> w63
          # if total frame, run receiver block
          # check if total frame
          # Stop while loop if checked whole fetch
          # w48: length of fetch
          case (w63) {
            frame False, Default {
              case ($"receiver on") {
                frame False, Default {
                  w64 = i32[] []
                  w65 = w46
                }
                frame True {
                  call "Receiver.gvi"(Interleaver=$Interleaver, Signal in=w61, filter length=$"filter length", filter parameter=$"filter parameter", IQ rate=w8, Symbol rate (sym/s)=w34, error in=w46, message length (symbols)=w33, sync frame index (symbols)=w32, barker code=w31, Frame sync=$"Frame sync", Freq sync=$"Freq sync", decoding=$decoding) -> (IQ diagram=w66, output bit stream=w64, Correlation=w67, error out=w65)
                  $"IQ diagram" <- w66
                  $"sync frame correlation" <- w67
                }
              }
              case ($"Receive sound") {
                frame True {
                  Enqueue Element(element=w64, error in=w65, queue=w25) -> (error out=w56)
                  Array Size(array=w64) -> (size(s)=w68)
                  Is Greater Than 0(x=w68) -> w69
                  case (w69) {
                    frame False, Default { }
                    frame True {
                      call "MT Pack Bits.gvi"(input bit stream=w64, bits per integer=8, packed bit order="MSB first", integer format="Unsigned") -> (output integers=w70)
                      Byte Array To String(encoding="Extended ASCII", unsigned byte array=w70) -> (string=w71)
                      $string <- w71
                    }
                  }
                  w58 = f64[] []
                }
                frame False {
                  call "Example signal.gvi"() -> (output bit stream=w72)
                  call "BER.gvi"(Output bit stream=w64, Input bit stream=w72, Array in=s8, error in=w65, Reset BER=$"Reset BER") -> (Correct Size=w73, Output array size=w74, Input array size=w75, current BER=w76, Mean_BER=w77, BER graph=w78, BER array=w58, error out=w56)
                  $"current BER" <- w76
                  $Mean_BER <- w77
                  $"BER graph" <- w78
                  $"Input array size" <- w75
                  $"Output array size" <- w74
                  $"Correct Size" <- w73
                }
              }
              Array Size(array=w61) -> (size(s)=w79)
              $"size(s)" <- w79
              Absolute Value(x=w61) -> w80
              $"one package" <- w80
              w57 = c128[] []
            }
            frame True {
              # if not total frame, append to next fetch
              Array Subset(array=w29, index0=w51) -> w57
              w56 = w46
              w58 = s8
            }
          }
          Subtract(x=w48, y=w55) -> w81
          # next index = current index + frame length +buffer
          Is Less Or Equal To 0(x=w81) -> w54
          # w55: Index + frame length + buffer
          Wait(time to wait=$"milliseconds to wait")
        }
      }
      $"current index" <- s7
      next s7 = w55
      next s8 = w58
      stop if w54
    }
    Array Size(array=w57) -> (size(s)=w82)
    Subtract(x=w30, y=w82) -> w83
    Array Subset(array=w29, length0=w83) -> w84
    # w57: array to next fetch
    Absolute Value(x=w84) -> w85
    $"Raw input" <- w85
    $"samples/symbol" <- w36
    Get Notifier Status(notifier=w14) -> (latest notification=w86, notifier out=w87)
    call "NotifyError.gvi"(notifier ref=w87, Notify anyway=$Stop_RX_2)
    $"dequeueing iteration" <- i2
    next s3 = w56
    next s4 = w27
    next s5 = s8
    next s6 = w57
    stop if w86
  }
  Release Queue(error in=s3, queue=s4) -> (error out=w88)
  call "niUSRP Abort.gvi"(session handle=w19, error in=w88) -> (session handle out=w89, error out=w90)
  call "niUSRP Close Session.gvi"(session handle=w89, error in=w90) -> (error out=w91)
  $"error out" <- w91
  $"actual IQ rate" <- w8
  $"actual carrier frequency" <- w9
  $"actual gain (dB)" <- w10
  call "Sink.gvi"(queue=w25, notifier ref=w14, error in=w24, net address_2="127.0.0.1", sink port=36363)
