vi "Sink.gvi"   [LabVIEW NXG 3.0.0]
inputs:
  "error in": error
  "queue": Queue<u8[]>
  "port": u16 = 36363
  "net address": string = "127.0.0.1"
  "connection ID in": UdpNetworkConnectionRefnum
outputs:
  "queue out": Queue<u8[]>
  "connection ID out": UdpNetworkConnectionRefnum
  "error out_2": error
uses:
  NI::Modulation::MT Pack Bits.gvi
diagram:
  Dequeue Element(error in=$"error in", queue=$queue) -> (element=w1, error out=w2, queue out=w3)
  $"queue out" <- w3
  Array Size(array=w1) -> (size(s)=w4)
  Is Greater Than 0(x=w4) -> w5
  case (w5) {
    frame False, Default {
      w6 = $"connection ID in"
      w7 = w2
    }
    frame True {
      call "MT Pack Bits.gvi"(input bit stream=w1, bits per integer=8, integer format="Unsigned", error in=w2) -> (output integers=w8, error out=w9)
      Udp Write Binary(address=$"net address", connection ID=$"connection ID in", data in=w8, error in=w9, port or service name=$port, timeout ms=-1) -> (connection ID out=w6, error out=w7)
    }
  }
  $"connection ID out" <- w6
  $"error out_2" <- w7
