vi "TestFreqSync.gvi"   [LabVIEW NXG 3.0.0]
panel controls:
  "message length (bits)": i32 = 1000
  "Samples per symbol": i32 = 16
  "frame insert index": i32
  "Insert frame": bool
  "Error in": error
  "padding bits": i32
  "Min correlation threshold": f64
  "compensate": bool
  "frequency offset": f64
  "compensate for phase offset": bool
  "Barker code": enum{"5", "7", "11", "random"} = "random"
panel indicators:
  "error out_2": error
  "BER": f64
  "output bit stream": i8[]
  "estimated phase drift": f64
  "correlation": f64[]
  "actual phase drift": f64
  "intercept": f64
  "source bit stream": i8[]
  "after compensation": f64[]
  "before compensation": f64[]
  "Before frame synch": f64[]
  "phase offset": f64
uses:
  NI::Analysis::Statistics::Mean (DBL).gvi
diagram:
  call "TestSync.gvi"(message length (bits)=$"message length (bits)", Samples per symbol=$"Samples per symbol", frame insert index=$"frame insert index", Insert frame=$"Insert frame", Error in=$"Error in", frequency offset=$"frequency offset", Barker code=$"Barker code", Min correlation threshold=$"Min correlation threshold", padding bits=$"padding bits") -> (framesync output=w1, Training Subcodes=w2, Graph=w3, source bit stream=w4, error out=w5, phase error=w6, channel=w7)
  case ($compensate) {
    frame False, Default {
      w8 = w5
      w9 = w1
      w10 = 0
      w11 = 0
      w12 = 0
    }
    frame True {
      call "FreqSync.gvi"(input=w1, Training codes=w2, Samples per symbol=$"Samples per symbol", Frame index=$"frame insert index", error in=w5, barker code=$"Barker code", compensate for phase offset=$"compensate for phase offset") -> (output=w9, slope=w10, intercept=w11, phase offset=w12, error out=w8)
    }
  }
  Complex To Real Imaginary(x + iy=w9) -> (x=w13)
  $"after compensation" <- w13
  Complex To Real Imaginary(x + iy=w1) -> (x=w14)
  $"before compensation" <- w14
  $correlation <- w3
  call "RemoveSyncFrame.gvi"(input=w9, samples per symbol=$"Samples per symbol", sync frame index (bits)=$"frame insert index", barker code=$"Barker code") -> (output=w15)
  call "Downsampler.gvi"(input signal=w15, message length=$"message length (bits)", error in=w8, samples per symbol=$"Samples per symbol") -> (output signal=w16, error out=w17)
  case (w17) {
    frame Error, Default {
      w18 = w17
      w19 = i8[] []
    }
    frame No Error {
      call "BPSKDemod.gvi"(symbols=w16, error in=w17) -> (output bit stream=w19, error out=w18)
    }
  }
  Is Not Equal(x=w4, y=w19) -> w20
  Boolean To Integer(Boolean=w20) -> (0, 1=w21)
  # Calculate BER
  case (w18) {
    frame Error, Default {
      w22 = w18
      w23 = -1
    }
    frame No Error {
      call "Mean (DBL).gvi"(x=w21, error in=w18) -> (mean=w23, error out=w22)
    }
  }
  $BER <- w23
  $"error out_2" <- w22
  $"estimated phase drift" <- w10
  $intercept <- w11
  $"actual phase drift" <- w6
  $"phase offset" <- w12
  $"output bit stream" <- w19
  Complex To Real Imaginary(x + iy=w7) -> (x=w24)
  $"Before frame synch" <- w24
  $"source bit stream" <- w4
