vi "TestSync.gvi"   [LabVIEW NXG 3.0.0]
inputs:
  "message length (bits)": i32 = 88
  "Error in": error
  "Samples per symbol": i32 = 16
  "frame insert index": i32 = 44
  "Barker code": enum{"5", "7", "11", "random"} = "random"
  "Min correlation threshold": f64
  "padding bits": i32 = 50
  "Insert frame": bool
  "frequency offset": f64
outputs:
  "Training Subcodes": c128[]
  "framesync output": c128[]
  "error out": error
  "Graph": f64[]
  "source bit stream": i8[]
  "phase error": f64
  "channel": c128[]
panel indicators:
  "BER": f64
  "output bit stream": i8[]
  "max index(es)": i32
uses:
  NI::Modulation::MT Generate Bits (Fibonacci, PN Order).gvi
  NI::Analysis::Generation::Ramp Pattern by Samples.gvi
  NI::Analysis::Statistics::Mean (DBL).gvi
diagram:
  Multiply(6.28, $"frequency offset") -> w1
  # optional carrier frequency shift
  $"phase error" <- w1
  Multiply($"padding bits", $"Samples per symbol") -> w2
  Initialize Array(element=0+0i, size=w2) -> w3
  Random Number() -> (number (0 to 1)=w4)
  Multiply(w4, 1000) -> w5
  To Long Integer(number=w5) -> w6
  call "MT Generate Bits (Fibonacci, PN Order).gvi"(total bits=$"message length (bits)", PN sequence order=10, seed in=w6, error in=$"Error in") -> (output bit stream=w7, error out=w8)
  call "BPSKMod.gvi"(input bit stream=w7, error in=w8) -> (Symbol out=w9, error out=w10)
  case ($"Insert frame") {
    frame False, Default {
      w11 = w9
    }
    frame True {
      call "SyncFrameInserter.gvi"(Signal in=w9, insert index=$"frame insert index", Barker code=$"Barker code") -> (Signal out=w11)
    }
  }
  call "Upsampler.gvi"(Signal in=w11, Samples per symbol=$"Samples per symbol", error in=w10) -> (Upsampled signal=w12, error out=w13)
  Insert Into Array(inArray=w12, index0=0, new=w3) -> w14
  # add padding before and after message to simulate a IQ fetch
  Array Size(array=w14) -> (size(s)=w15)
  Insert Into Array(inArray=w14, index0=w15, new=w3) -> w16
  $channel <- w16
  Array Size(array=w16) -> (size(s)=w17)
  Multiply(w1, w17) -> w18
  call "Ramp Pattern by Samples.gvi"(samples=w17, end=w18) -> (ramp pattern=w19)
  Add(w1, w19) -> w20
  Polar To Complex(r=1, theta=w20) -> (r * e^(i*theta)=w21)
  Multiply(w16, w21) -> w22
  call "FrameSync.gvi"(input signal=w22, samples per symbol=$"Samples per symbol", message length (symbols)=$"message length (bits)", error in=w13, sync frame index (symbols)=$"frame insert index", barker code=$"Barker code", Min correlation=$"Min correlation threshold") -> (output signal=w23, Correlation=w24, max index=w25, Training Subcodes=w26, error out=w27)
  call "RemoveSyncFrame.gvi"(input=w23, samples per symbol=$"Samples per symbol", sync frame index (bits)=$"frame insert index", barker code=$"Barker code") -> (output=w28)
  call "Downsampler.gvi"(input signal=w28, message length=$"message length (bits)", error in=w27, samples per symbol=$"Samples per symbol") -> (output signal=w29, error out=w30)
  case (w30) {
    frame Error, Default {
      w31 = w30
      w32 = i8[] []
    }
    frame No Error {
      call "BPSKDemod.gvi"(symbols=w29, error in=w30) -> (output bit stream=w32, error out=w31)
    }
  }
  Is Not Equal(x=w7, y=w32) -> w33
  Boolean To Integer(Boolean=w33) -> (0, 1=w34)
  # Calculate BER
  case (w31) {
    frame Error, Default {
      w35 = w31
      w36 = -1
    }
    frame No Error {
      call "Mean (DBL).gvi"(x=w34, error in=w31) -> (mean=w36, error out=w35)
    }
  }
  $BER <- w36
  $"framesync output" <- w23
  $"source bit stream" <- w7
  $"error out" <- w35
  $"Training Subcodes" <- w26
  $"max index(es)" <- w25
  $"output bit stream" <- w32
  Absolute Value(x=w24) -> w37
  $Graph <- w37
