vi "Source.gvi"   [LabVIEW NXG 3.0.0]
inputs:
  "error in": error
outputs:
  "output bit stream": u8[]
  "Output": Queue<u8[]>
  "error out": error
panel controls:
  "stop": bool
uses:
  source.mli::source matlab
  NI::G Core::Error::Is Error.gvi
diagram:
  Obtain Queue(element data type=u8[] [], error in=$"error in") -> (error out=w1, queue out=w2)
  s1 = w2  # shift register
  s2 = uninitialised  # shift register
  while {
    call "source matlab"(error in=w1) -> (data=w3, error out=w4)
    $"output bit stream" <- w3
    Is Not Equal[ComparisonMode=CompareAggregates](x=s2, y=w3) -> w5
    # Call matlab script
    case (w5) {
      frame False, Default {
        w6 = w4
        w7 = s1
      }
      frame True {
        Enqueue Element(element=w3, error in=w4, queue=s1) -> (error out=w6, queue out=w7)
      }
    }
    call "Is Error.gvi"(error in=w6) -> (error?=w8)
    Logical Or($stop, w8) -> w9
    next s1 = w7
    next s2 = w3
    stop if w9
  }
  $"error out" <- w6
  $Output <- w2
