vi "TransmitterBlock.gvi"   [LabVIEW NXG 3.0.0]
panel controls:
  "IQ rate": f64 = 160000
  "carrier frequency": f64 = 2450000000
  "Active antenna": string = "TX1"
  "stop": bool
  "Device name": string = "USRP_06"
  "gain": f64
  "RF channel": string = "0"
  "filter parameter": f64 = 0.5
  "filter length": i32 = 8
  "Symbol rate (sym/s)": i32 = 10000
  "Barker insert index": i32 = 64
  "message length (bits)": i32 = 128
  "Barker code": enum{"5", "7", "11", "random"} = "11"
  "Padding length": i32 = 111
  "encode": bool
  "Frame sync": bool = TRUE
  "Send sound": bool
  "Interleaver": bool
  "source port": u16 = 26363
  "net address_2": string = "127.0.0.1"
  "preamble?": bool = TRUE
  "Preamble code": enum{"5", "7", "11", "random"} = "7"
  "Flush_queue": bool
panel indicators:
  "actual IQ rate": f64
  "actual carrier frequency": f64
  "actual gain (dB)": f64
  "error out": error
  "Baseband Waveform (absolute value)": waveform<f64>
  "IQ diagram": c128[]
  "actual message length": i32
  "Transmitting": bool
  "number elements in queue": i32
  "milliseconds": u32
  "FPS": f64
  "Underflow?": bool  # specific error cleared? indicates whether the error referenced by specific error code to clear has been cleared.
uses:
  NI::USRP::niUSRP Open Tx Session.gvi
  NI::USRP::niUSRP Configure Signal.gvi
  NI::USRP::niUSRP Write Tx Data (CDB).gvi
  NI::G Core::Error::Filter Error Code.gvi
  NI::USRP::niUSRP Close Session.gvi
  NI::G Core::Error::Multiplex Errors.gvi
diagram:
  w1 = $"RF channel"
  call "niUSRP Open Tx Session.gvi"(device names=$"Device name") -> (session handle out=w2, error out=w3)
  Property Node(instance in=w2, "niUSRP"=w1, error in=w3) -> (error out=w4, instance out=w5)
  call "niUSRP Configure Signal.gvi"(active antenna=$"Active antenna", session handle=w5, error in=w4, IQ rate=$"IQ rate", carrier frequency=$"carrier frequency", gain=$gain, channel list=w1) -> (session handle out=w6, error out=w7, coerced IQ rate=w8, coerced carrier frequency=w9, coerced gain=w10)
  Obtain Notifier(element data type=bool TRUE, error in=w7, name="error") -> (error out=w11, notifier out=w12)
  Obtain Queue(element data type=u8[] []) -> (queue out=w13)
  call "Source.gvi"(queue=w13, notifier ref=w12, error in=w11, net address=$"net address_2", source port=$"source port") -> (error out=w14)
  s1 = uninitialised  # shift register
  while {
    Tick Count() -> (timer value=w15)
    Subtract(x=w15, y=s1) -> w16
    Reciprocal(x=w16) -> w17
    Multiply(w17, 1000) -> w18
    $FPS <- w18
    $milliseconds <- w16
    Get Notifier Status(notifier=w12) -> (latest notification=w19)
    case (w19) {
      frame True {
        w20 = w7
        w21 = w6
      }
      frame False {
        case ($Flush_queue) {
          frame False, Default { }
          frame True {
            Flush Queue(queue=w13)
          }
        }
        case ($"Send sound") {
          frame False, Default {
            call "Example signal.gvi"(message length (bits)=$"message length (bits)") -> (output bit stream=w22)
            w23 = w7
            w24 = TRUE
          }
          frame True {
            Get Queue Status(queue=w13) -> (# elements in queue=w25)
            $"number elements in queue" <- w25
            Is Greater(x=w25, y=50)
            case (TRUE) {
              frame False, Default {
                w22 = u8[] []
              }
              frame True {
                Dequeue Element(queue=w13, timeout in ms=15) -> (element=w22)
              }
            }
            w23 = w7
            w24 = TRUE
          }
        }
        Array Size(array=w22) -> (size(s)=w26)
        Subtract(x=$"message length (bits)", y=w26) -> w27
        call "ZeroPaddingInt.gvi"(Input=w22, Padding length=w27, samples per symbol=1, pad beginning=FALSE, pad end=TRUE) -> (output array=w28)
        Is Greater(x=w26, y=0) -> w29
        Logical And(w29, w24) -> w30
        case (w30) {
          frame False, Default {
            w31 = $stop
            w20 = w23
            w21 = w6
          }
          frame True {
            call "Transmitter.gvi"(filter parameter=$"filter parameter", filter length=$"filter length", Interleaver=$Interleaver, input bit stream=w28, IQ rate=w8, Symbol rate (sym/s)=$"Symbol rate (sym/s)", Frame sync=$"Frame sync", error in=w23, Barker code=$"Barker code", Barker insert index=$"Barker insert index", encode=$encode, preamble?=$"preamble?", Preamble code=$"Preamble code") -> (signal out=w32, IQ diagram=w33, error out=w34)
            $"IQ diagram" <- w33
            Divide(x=w8, y=$"Symbol rate (sym/s)") -> w35
            call "ZeroPaddingDbl.gvi"(Input=w32, Padding length=$"Padding length", samples per symbol=w35) -> (output array=w36)
            call "niUSRP Write Tx Data (CDB).gvi"(session handle=w6, error in=w34, data=w36, end of data?=$stop, channel list=w1) -> (session handle out=w21, error out=w37)
            # ignore underflow
            call "Filter Error Code.gvi"(error in=w37, code to clear=-1074118645) -> (error out=w20, error cleared?=w38)
            $"Underflow?" <- w38
            Absolute Value(x=w36) -> w39
            Reciprocal(x=$"Symbol rate (sym/s)") -> w40
            Build Waveform Node(Y=w39, dt=w40) -> (output waveform=w41)
            $"Baseband Waveform (absolute value)" <- w41
            w31 = $stop
          }
        }
        call "NotifyError.gvi"(notifier ref=w12, Notify anyway=w31, error in=w20)
        $"actual message length" <- w26
        $Transmitting <- w30
      }
    }
    next s1 = w15
    stop if w19
  }
  call "niUSRP Close Session.gvi"(session handle=w21, error in=w20) -> (error out=w42)
  call "Multiplex Errors.gvi"(error in 1=w14, error in 2=w42) -> (error out=w43)
  Release Notifier(error in (no error)=w43, notifier=w12) -> (error out=w44)
  $"error out" <- w44
  $"actual IQ rate" <- w8
  $"actual carrier frequency" <- w9
  $"actual gain (dB)" <- w10
